# Dynamo graph get windowMetadata_1752240238047.dyn "get windowMetadata" (Dynamo 3.3.0.6316)

categories = Categories("OST_Walls")
all_elements_of_category = ElementsOfCategory(Category=categories)
pick_model_elements = DSModelElementMultipleSelection()  # 1036 picked in the model
list_create = List.Create(item0=pick_model_elements)
file_path = Filename("D:\Mostafa\PhD\Walls_20250618-141039.csv")
python_script = Python(IN[0]=list_create, IN[1]=file_path)  # CPython3
# ---------- python_script.python (229 lines) ----------
# -*- coding: utf-8 -*-
"""
Wall & Hosted-Insert Exporter – v9  (2025-06-20)

• Exports wall geometry / orientation / quantities.
• Exports hosted inserts (windows, doors …) with orientation and glazing area
  (material OR sub-category contains “glass” or “glazing”).
• Fully recursive GeometryInstance walk.
• ALL Revit-API property reads wrapped in safe_attr → no TypeError dialogs.
• Robust Family / Type retrieval works in every Revit version.
• Outputs two timestamped CSV files named:
    <RevitProject>-WindowsAndGlassAreas-<timestamp>.csv
    <RevitProject>-wallsSelfShading-<timestamp>.csv
"""

import clr, os, re, csv, math
from datetime import datetime

# ── Revit plumbing ────────────────────────────────────────────────────────
clr.AddReference("RevitAPI")
from Autodesk.Revit.DB import ElementId, Options, GeometryInstance, Solid

clr.AddReference("RevitServices")
from RevitServices.Persistence import DocumentManager

clr.AddReference("RevitNodes")
import Revit                                    # noqa: F401
clr.ImportExtensions(Revit.Elements)

doc = DocumentManager.Instance.CurrentDBDocument

# ── helpers ───────────────────────────────────────────────────────────────
def safe_attr(obj, attr, default=None):
    """Return obj.attr if possible, otherwise default."""
    try:
        return getattr(obj, attr, default)
    except Exception:
        return default

def safe_call(fn, default=None):
    """Call fn() and return its value or default on any error."""
    try:
        return fn()
    except Exception:
        return default

FT2M, SQFT2M2, CUFT2M3 = 0.3048, 0.092903, 0.0283168
def get_param(elem, name, fac=1.0):
    return safe_call(lambda: round(elem.LookupParameter(name).AsDouble()*fac, 2))

def az(v):  return round((math.degrees(math.atan2(v.X, v.Y))+360) % 360, 2)
def vec(v): return round(v.X,2), round(v.Y,2), round(v.Z,2)

def safe_faces(solid):
    return safe_call(lambda: list(solid.Faces), [])

def safe_subcat(face):
    gs = safe_call(lambda: doc.GetElement(face.GraphicsStyleId))
    cat = safe_attr(gs, "GraphicsStyleCategory")
    return safe_attr(cat, "Name", "")

# ── inputs ────────────────────────────────────────────────────────────────
walls_in, path_in = IN[0], IN[1]

# ── path handling ─────────────────────────────────────────────────────────
def make_paths(p):
    """Return two output paths based on Revit project title plus timestamp."""
    if isinstance(p, list):
        if len(p) != 1 or not isinstance(p[0], str):
            raise ValueError("IN[1] must be a file-path string or list of one.")
        p = p[0]
    if not isinstance(p, str):
        raise ValueError("IN[1] must be a string.")

    # folder: either the directory part of p or p itself if it is a folder
    folder = os.path.dirname(p) if os.path.splitext(p)[1] else p
    if folder and not os.path.exists(folder):
        os.makedirs(folder)

    # sanitise Revit project title for file-system safety
    title = re.sub(r'[\\/*?:"<>|]', "_", doc.Title).strip()
    if not title:
        title = "UntitledProject"

    ext = ".csv"
    ts  = datetime.now().strftime("%Y%m%d-%H%M%S")

    base = os.path.join(folder, title) if folder else title
    return (
        f"{base}-WindowsAndGlassAreas-{ts}{ext}",
        f"{base}-wallsSelfShading-{ts}{ext}"
    )

windows_csv, walls_csv = make_paths(path_in)

# ── unwrap input selection to DB elements ─────────────────────────────────
def to_db(e):
    if hasattr(e, "InternalElement"):
        return e.InternalElement
    if isinstance(e, ElementId):
        return doc.GetElement(e)
    if isinstance(e, int):
        return doc.GetElement(ElementId(e))
    return e

walls = [
    to_db(w)
    for sub in walls_in
    for w in (sub if isinstance(sub, list) else [sub])
    if to_db(w)
]

# ── WALL DATA ─────────────────────────────────────────────────────────────
wall_rows = []
for w in walls:
    wid   = w.Id.IntegerValue
    name  = safe_attr(w, "Name", "")
    wtype = safe_attr(safe_attr(w, "WallType"), "Name", "")

    level = safe_call(lambda: doc.GetElement(w.LevelId).Name)

    try:
        ox, oy, oz = vec(w.Orientation)
        azi = az(w.Orientation)
    except Exception:
        ox = oy = oz = azi = None

    wall_rows.append([
        wid, name, wtype, level,
        get_param(w, "Length", FT2M),
        get_param(w, "Area",   SQFT2M2),
        get_param(w, "Volume", CUFT2M3),
        ox, oy, oz, azi
    ])

# ── HOSTED DATA ───────────────────────────────────────────────────────────
opts = Options(); opts.IncludeNonVisibleObjects = True
keywords = ("glass", "glazing")
def is_glass(txt): return any(k in (txt or "").lower() for k in keywords)

def glass_stats(geom_iter):
    total = 0.0
    source = None
    for obj in geom_iter:
        if obj is None:
            continue
        if isinstance(obj, GeometryInstance):
            a, s = glass_stats(obj.GetInstanceGeometry())
            total += a
            if s and not source:
                source = s
        elif isinstance(obj, Solid):
            for f in safe_faces(obj):
                sub = safe_subcat(f)
                mat = safe_attr(doc.GetElement(f.MaterialElementId), "Name", "")
                if is_glass(sub) or is_glass(mat):
                    if not source:
                        source = sub or mat
                    total += safe_call(lambda: f.Area, 0)
    return total, source

host_rows = []
for host in walls:
    inserts = safe_call(lambda: host.FindInserts(True, False, False, False), [])

    for iid in inserts or []:
        inst = doc.GetElement(iid)
        if not inst:
            continue

        cid  = inst.Id.IntegerValue
        cat  = safe_attr(inst.Category, "Name", "")

        # robust Family / Type
        fam = typ = ""
        sym = safe_attr(inst, "Symbol") or doc.GetElement(safe_call(inst.GetTypeId))
        if sym:
            typ = safe_attr(sym, "Name", "")
            fam = safe_attr(sym, "FamilyName", "") \
                  or safe_attr(safe_attr(sym, "Family"), "Name", "")

        lvl = ""
        lp  = safe_call(lambda: inst.LookupParameter("Level"))
        if lp and lp.HasValue:
            lvl = safe_call(lambda: doc.GetElement(lp.AsElementId()).Name, "")

        try:
            hox, hoy, hoz = vec(inst.FacingOrientation)
            hazi = az(inst.FacingOrientation)
        except Exception:
            hox = hoy = hoz = hazi = None

        geom = safe_call(lambda: inst.get_Geometry(opts), [])
        gsf, gsrc = glass_stats(geom)
        garea = round(gsf * SQFT2M2, 2) if gsf else None

        host_rows.append([
            cid, cat, fam, typ, lvl, host.Id.IntegerValue,
            hox, hoy, hoz, hazi, gsrc, garea
        ])

# ── CSV writer ────────────────────────────────────────────────────────────
def write_csv(path, header, rows):
    try:
        with open(path, "w", newline="", encoding="utf-8-sig") as f:
            csv.writer(f).writerows([header] + rows)
        return path
    except PermissionError:
        base, ext = os.path.splitext(path)
        alt = f"{base}_{datetime.now().strftime('%H%M%S')}{ext}"
        with open(alt, "w", newline="", encoding="utf-8-sig") as f:
            csv.writer(f).writerows([header] + rows)
        return alt

hdr_walls = [
    "ElementId", "Name", "Wall Type", "Level",
    "Length (m)", "Area (m²)", "Volume (m³)",
    "OriX", "OriY", "OriZ", "Azimuth (°)"
]
hdr_hosted = [
    "ElementId", "Category", "Family", "Type", "Level", "HostWallId",
    "OriX", "OriY", "OriZ", "Azimuth (°)",
    "Glass Source", "Glass Area (m²)"
]

OUT = (
    write_csv(windows_csv, hdr_hosted, host_rows),  # Windows & Glass Areas
    write_csv(walls_csv,   hdr_walls,  wall_rows)   # Walls Self-Shading
)
# ----------------------------------------
watch = Watch(python_script)
watch_2 = Watch(categories)
working_code_for_the_wall_and_id = Python()  # "working Code for the wall and ID and dims"; CPython3; frozen; unwired: IN[0]
# ---------- working_code_for_the_wall_and_id.python (109 lines) ----------
# -*- coding: utf-8 -*-
# Dynamo 2.x – works in both IronPython 2.7 and CPython 3 nodes

import clr, sys
clr.AddReference('RevitAPI')
clr.AddReference('RevitServices')
from Autodesk.Revit.DB import BuiltInParameter, UnitUtils
from RevitServices.Persistence import DocumentManager
doc = DocumentManager.Instance.CurrentDBDocument

# ---------- Unit helpers (Revit 2021+ vs earlier) ----------------------------
try:                               # Revit 2021+
    from Autodesk.Revit.DB import UnitTypeId as _U
    M, M2, M3 = _U.Meters, _U.SquareMeters, _U.CubicMeters
except ImportError:                # Revit ≤2020
    from Autodesk.Revit.DB import DisplayUnitType as _U
    M, M2, M3 = _U.Meters, _U.SquareMeters, _U.CubicMeters

def to_unit(val, ut):
    return UnitUtils.ConvertFromInternalUnits(val, ut)

# ---------- utilities --------------------------------------------------------
def flatten(xs):
    for x in xs:
        if isinstance(x, (list, tuple)):
            for y in flatten(x):
                yield y
        else:
            yield x

def unwrap(e):
    if e is None: return None
    if hasattr(e, "InternalElement"):  # Dynamo wrapper
        return e.InternalElement
    if hasattr(e, "Id"):               # raw element
        return e
    try:                               # maybe ElementId/int
        from Autodesk.Revit.DB import ElementId
        return doc.GetElement(ElementId(int(e)))
    except Exception:
        return None

# ---------- take input -------------------------------------------------------
raw_in = IN[0] if IN and len(IN) else []
elements = [unwrap(x) for x in flatten(raw_in)]

walls = []
for e in elements:                     # <= no list-comp! safer
    try:
        if e and e.Category and e.Category.Name == "Walls":
            walls.append(e)
    except Exception:                  # “property cannot be read”
        pass

# ---------- output table -----------------------------------------------------
table = [[
    "ElementId", "Name", "Wall Type", "Level",
    "Length (m)", "Area (m²)", "Volume (m³)", "Hosted Element Ids"
]]

def safe_double(elem, bip):
    try:
        p = elem.get_Parameter(bip)
        if p and p.HasValue:
            return p.AsDouble()
    except Exception:                  # catches “property cannot be read”
        pass
    return None

for w in walls:
    eid   = w.Id.IntegerValue
    name  = getattr(w, "Name", "Unnamed Wall") or "Unnamed Wall"

    try:
        wtype = doc.GetElement(w.GetTypeId()).Name
    except Exception:
        wtype = "—"

    try:
        level = doc.GetElement(w.LevelId).Name
    except Exception:
        level = "—"

    ln  = safe_double(w, BuiltInParameter.CURVE_ELEM_LENGTH)
    ar  = safe_double(w, BuiltInParameter.HOST_AREA_COMPUTED)
    vol = safe_double(w, BuiltInParameter.HOST_VOLUME_COMPUTED)

    # fallback length from location curve
    if ln is None:
        try:
            if w.Location: ln = w.Location.Curve.Length
        except Exception:
            pass

    length = round(to_unit(ln,  M), 2)  if ln  else None
    area   = round(to_unit(ar,  M2), 2) if ar  else None
    volume = round(to_unit(vol, M3), 2) if vol else None

    # hosted elements
    try:
        hosted_ids = [hid.IntegerValue
                      for hid in w.GetHostedElements(True, True, True, True)]
    except Exception:
        hosted_ids = None

    table.append([eid, name, wtype, level,
                  length, area, volume, hosted_ids])

OUT = table if len(table) > 1 else [["No walls found in input"]]
# ----------------------------------------
workingcode_with_wall_and_hosted = Python()  # "WorkingCode with wall and hosted elements"; CPython3; frozen; unwired: IN[0], IN[1]
# ---------- workingcode_with_wall_and_hosted.python (150 lines) ----------
import clr, os, csv

# --- Revit & Dynamo plumbing ---------------------------------------------
# Revit API
clr.AddReference("RevitAPI")
from Autodesk.Revit.DB import ElementId

# Dynamo / RevitServices
clr.AddReference("RevitServices")
from RevitServices.Persistence import DocumentManager

# CPython3 node needs this to unwrap Dynamo wrappers:
clr.AddReference("RevitNodes")
import Revit
clr.ImportExtensions(Revit.Elements)

doc = DocumentManager.Instance.CurrentDBDocument

# --- inputs ---------------------------------------------------------------
walls_in = IN[0]
path_in  = IN[1]

# --- normalize file path -------------------------------------------------
# allow a single‐item list of string or a bare string
if isinstance(path_in, list):
    if len(path_in)!=1 or not isinstance(path_in[0], str):
        raise ValueError("IN[1] must be a single file‐path string (or list of one).")
    file_path = path_in[0]
elif isinstance(path_in, str):
    file_path = path_in
else:
    raise ValueError("IN[1] must be a string or single‐item list of string.")

# ensure folder exists (but don’t confuse file name with folder)
folder = os.path.dirname(file_path)
if folder and not os.path.exists(folder):
    os.makedirs(folder)

# build hosted‐elements filename
base, ext = os.path.splitext(file_path)
if not ext:
    ext = ".csv"
hosted_path = base + "_Hosted" + ext

# --- flatten one level of nesting ----------------------------------------
flat = []
for item in walls_in:
    if isinstance(item, list):
        flat.extend(item)
    else:
        flat.append(item)

# --- helper: unwrap to DB element ----------------------------------------
def to_db(elem):
    # Dynamo wrapper
    if hasattr(elem, "InternalElement"):
        return elem.InternalElement
    # raw ElementId
    if isinstance(elem, ElementId):
        return doc.GetElement(elem)
    # plain int
    if isinstance(elem, int):
        return doc.GetElement(ElementId(elem))
    # assume already a DBElement
    return elem

walls = [to_db(w) for w in flat if to_db(w) is not None]

# --- unit conversion factors ---------------------------------------------
FT2M    = 0.3048
SQFT2M2 = 0.092903
CUFT2M3 = 0.0283168

def get_param(elem, name, factor=1.0):
    p = elem.LookupParameter(name)
    if p is None or not p.HasValue:
        return None
    try:
        return p.AsDouble() * factor
    except:
        return None

# --- collect wall data ---------------------------------------------------
wall_rows = []
for w in walls:
    wid   = w.Id.IntegerValue
    name  = getattr(w, "Name", "")
    # wall‐type name
    try:    wtype = w.WallType.Name
    except: wtype = ""
    # level
    lvl = ""
    try:
        lid = w.LevelId
        lvl = doc.GetElement(lid).Name if lid else ""
    except:
        pass
    length = get_param(w, "Length", FT2M)
    area   = get_param(w, "Area",   SQFT2M2)
    volume = get_param(w, "Volume", CUFT2M3)
    wall_rows.append([wid, name, wtype, lvl, length, area, volume])

# --- collect hosted‐insert data ------------------------------------------
hosted_rows = []
for w in walls:
    host_id = w.Id.IntegerValue
    try:
        inserts = w.FindInserts(True, False, False, False)
    except:
        inserts = []
    for eid in inserts:
        inst = doc.GetElement(eid)
        if inst is None: 
            continue
        iid  = inst.Id.IntegerValue
        cat  = inst.Category.Name if inst.Category else ""
        fam  = ""
        typ  = ""
        try:
            sym = inst.Symbol
            fam = sym.Family.Name
            typ = sym.Name
        except:
            pass
        # instance level
        lvl = ""
        lp  = inst.LookupParameter("Level")
        if lp and lp.HasValue:
            try:
                lvl = doc.GetElement(lp.AsElementId()).Name
            except:
                pass
        hosted_rows.append([iid, cat, fam, typ, lvl, host_id])

# --- write the two CSVs --------------------------------------------------
with open(file_path,   "w", newline="", encoding="utf-8-sig") as f:
    w = csv.writer(f)
    w.writerow(["ElementId","Name","Wall Type","Level",
                "Length (m)","Area (m²)","Volume (m³)"])
    w.writerows(wall_rows)

with open(hosted_path, "w", newline="", encoding="utf-8-sig") as f:
    w = csv.writer(f)
    w.writerow(["ElementId","Category","Family","Type",
                "Level","HostWallId"])
    w.writerows(hosted_rows)

# --- outputs --------------------------------------------------------------
# returns the two paths so you can drill‐open them from Dynamo
OUT = file_path, hosted_path
# ----------------------------------------
python_script_2 = Python()  # CPython3; frozen; unwired: IN[0], IN[1]
# ---------- python_script_2.python (197 lines) ----------
import clr, os, csv, math
from datetime import datetime

# --- Revit & Dynamo plumbing ---------------------------------------------
clr.AddReference("RevitAPI")
from Autodesk.Revit.DB import ElementId, Options

clr.AddReference("RevitServices")
from RevitServices.Persistence import DocumentManager

clr.AddReference("RevitNodes")
import Revit
clr.ImportExtensions(Revit.Elements)

doc = DocumentManager.Instance.CurrentDBDocument

# --- inputs ---------------------------------------------------------------
walls_in = IN[0]
path_in  = IN[1]

# --- normalize file path -------------------------------------------------
if isinstance(path_in, list):
    if len(path_in)!=1 or not isinstance(path_in[0], str):
        raise ValueError("IN[1] must be a file-path string or list of one.")
    file_path = path_in[0]
elif isinstance(path_in, str):
    file_path = path_in
else:
    raise ValueError("IN[1] must be a string or single-item list of string.")

folder = os.path.dirname(file_path)
if folder and not os.path.exists(folder):
    os.makedirs(folder)

base, ext = os.path.splitext(file_path)
if not ext:
    ext = ".csv"
ts = datetime.now().strftime("%Y%m%d-%H%M%S")
file_path   = f"{base}_{ts}{ext}"
hosted_path = f"{base}_Hosted_{ts}{ext}"

# --- flatten nesting & unwrap to DB elements -----------------------------
flat = []
for item in walls_in:
    flat.extend(item) if isinstance(item, list) else flat.append(item)

def to_db(e):
    if hasattr(e, "InternalElement"): return e.InternalElement
    if isinstance(e, ElementId):        return doc.GetElement(e)
    if isinstance(e, int):              return doc.GetElement(ElementId(e))
    return e

walls = [to_db(w) for w in flat if to_db(w) is not None]

# --- unit conversion & param helper --------------------------------------
FT2M    = 0.3048
SQFT2M2 = 0.092903
CUFT2M3 = 0.0283168

def get_param(elem, name, factor=1.0):
    p = elem.LookupParameter(name)
    if not p or not p.HasValue: return None
    try:
        return round(p.AsDouble()*factor, 2)
    except:
        return None

# --- orientation helpers -------------------------------------------------
def azimuth_from_vec(v):
    ang = math.degrees(math.atan2(v.X, v.Y))
    return round((ang+360)%360, 2)

def vec_components(v):
    return round(v.X,2), round(v.Y,2), round(v.Z,2)

# --- collect wall data ---------------------------------------------------
wall_rows = []
for w in walls:
    wid   = w.Id.IntegerValue
    name  = getattr(w, "Name", "")
    try:    wtype = w.WallType.Name
    except: wtype = ""
    lvl = ""
    try:
        lid = w.LevelId
        lvl = doc.GetElement(lid).Name if lid else ""
    except: pass

    length = get_param(w, "Length", FT2M)
    area   = get_param(w, "Area",   SQFT2M2)
    volume = get_param(w, "Volume", CUFT2M3)

    # orientation vector + azimuth
    try:
        v = w.Orientation
        ox, oy, oz = vec_components(v)
        azi = azimuth_from_vec(v)
    except:
        ox=oy=oz=azi=None

    wall_rows.append([
        wid, name, wtype, lvl,
        length, area, volume,
        ox, oy, oz, azi
    ])

# --- collect hosted-insert data ------------------------------------------
hosted_rows = []
opts = Options()

for w in walls:
    host_id = w.Id.IntegerValue
    try:
        inserts = w.FindInserts(True, False, False, False)
    except:
        inserts = []

    for eid in inserts:
        inst = doc.GetElement(eid)
        if not inst: continue

        iid = inst.Id.IntegerValue
        cat = inst.Category.Name if inst.Category else ""
        fam=typ=""
        try:
            sym = inst.Symbol
            fam = sym.Family.Name
            typ = sym.Name
        except: pass

        lvl=""
        lp = inst.LookupParameter("Level")
        if lp and lp.HasValue:
            try:
                lvl = doc.GetElement(lp.AsElementId()).Name
            except: pass

        # orientation
        try:
            fv = inst.FacingOrientation
            hox, hoy, hoz = vec_components(fv)
            hazi = azimuth_from_vec(fv)
        except:
            hox=hoy=hoz=hazi=None

        # glass area for windows
        glass=None
        if cat.lower()=="windows":
            total=0.0
            try:
                geom = inst.get_Geometry(opts)
            except:
                geom=[]
            for g in geom:
                solid = g if hasattr(g,"Faces") else None
                if not solid: continue
                for face in solid.Faces:
                    mid = face.MaterialElementId
                    if mid and mid.IntegerValue>=0:
                        mat = doc.GetElement(mid)
                        if mat and "glass" in mat.Name.lower():
                            total += face.Area * SQFT2M2
            glass = round(total,2)

        hosted_rows.append([
            iid, cat, fam, typ, lvl, host_id,
            hox, hoy, hoz, hazi, glass
        ])

# --- CSV writer with retry ------------------------------------------------
def write_csv(path, header, rows):
    try:
        with open(path,"w",newline="",encoding="utf-8-sig") as f:
            w=csv.writer(f)
            w.writerow(header)
            w.writerows(rows)
        return path
    except PermissionError:
        b,e=os.path.splitext(path)
        ts2=datetime.now().strftime("%Y%m%d-%H%M%S")
        newp=f"{b}_{ts2}{e}"
        with open(newp,"w",newline="",encoding="utf-8-sig") as f:
            w=csv.writer(f)
            w.writerow(header)
            w.writerows(rows)
        return newp

h1 = ["ElementId","Name","Wall Type","Level",
      "Length (m)","Area (m²)","Volume (m³)",
      "OriX","OriY","OriZ","Azimuth (°)"]
h2 = ["ElementId","Category","Family","Type","Level","HostWallId",
      "OriX","OriY","OriZ","Azimuth (°)","Glass Area (m²)"]

out1 = write_csv(file_path,   h1, wall_rows)
out2 = write_csv(hosted_path, h2, hosted_rows)

OUT = out1, out2
# ----------------------------------------
